test file "InductionCookerTestSuite"

suite "TestSuiteInductionCooker"

  case "Test Case 1" [baseline]
    model InductionCoockerStateFlow, harness InductionCookerStateFlow_HarnessInductionCookerS1 (for InductionCoockerStateFlow/InductionCooker)
    test sequence scenario: Scenario_1 (InductionCookerStateFlow_HarnessInductionCookerS1/Test Sequence)

  case "Test Case 2" [baseline]
    model InductionCoockerStateFlow, harness InductionCookerStateFlow_HarnessInductionCookerS2 (for InductionCoockerStateFlow/InductionCooker)
    test sequence scenario: Scenario_1 (InductionCookerStateFlow_HarnessInductionCookerS2/Test Sequence)

  case "Test Case 3" [baseline]
    model InductionCoockerStateFlow, harness InductionCookerStateFlow_HarnessInductionCookerS3 (for InductionCoockerStateFlow/InductionCooker)
    test sequence scenario: Scenario_1 (InductionCookerStateFlow_HarnessInductionCookerS3/Test Sequence)

  case "Test Case 4" [baseline]
    model InductionCoockerStateFlow, harness InductionCookerStateFlow_HarnessInductionCookerS4 (for InductionCoockerStateFlow/InductionCooker)
    test sequence scenario: Scenario_1 (InductionCookerStateFlow_HarnessInductionCookerS4/Test Sequence)

  case "Test Case 5" [baseline]
    model InductionCoockerStateFlow, harness InductionCookerStateFlow_HarnessInductionCookerS5 (for InductionCoockerStateFlow/InductionCooker)
    test sequence scenario: Scenario_1 (InductionCookerStateFlow_HarnessInductionCookerS5/Test Sequence)

  case "Test Case 6" [baseline]
    model InductionCoockerStateFlow, harness InductionCookerStateFlow_HarnessInductionCookerS6 (for InductionCoockerStateFlow/InductionCooker)
    test sequence scenario: Scenario_1 (InductionCookerStateFlow_HarnessInductionCookerS6/Test Sequence)

  case "Test Case 7" [baseline]
    model InductionCoockerStateFlow, harness InductionCookerStateFlow_HarnessInductionCookerS7 (for InductionCoockerStateFlow/InductionCooker)
    test sequence scenario: Scenario_1 (InductionCookerStateFlow_HarnessInductionCookerS7/Test Sequence)

  case "Test Case 8" [baseline]
    model InductionCoockerStateFlow, harness InductionCookerStateFlow_HarnessInductionCookerS8 (for InductionCoockerStateFlow/InductionCooker)
    test sequence scenario: Scenario_1 (InductionCookerStateFlow_HarnessInductionCookerS8/Test Sequence)

  case "Test Case 9" [baseline]
    model InductionCoockerStateFlow, harness InductionCookerStateFlow_HarnessInductionCookerS9 (for InductionCoockerStateFlow/InductionCooker)
    test sequence scenario: Scenario_1 (InductionCookerStateFlow_HarnessInductionCookerS9/Test Sequence)

  case "Test Case 10" [baseline]
    model InductionCoockerStateFlow, harness InductionCookerStateFlow_HarnessInductionCookerS10 (for InductionCoockerStateFlow/InductionCooker)
    test sequence scenario: Scenario_1 (InductionCookerStateFlow_HarnessInductionCookerS10/Test Sequence)

  case "Test Case 11" [baseline]
    model InductionCoockerStateFlow, harness InductionCookerStateFlow_HarnessInductionCookerS11 (for InductionCoockerStateFlow/InductionCooker)
    test sequence scenario: Scenario_1 (InductionCookerStateFlow_HarnessInductionCookerS11/Test Sequence)

suite "TestSuiteButton"

  case "Test Case 1" [baseline]
    model InductionCoockerStateFlow, harness InductionCookerStateFlow_HarnessButtonS1 (for InductionCoockerStateFlow/on_off_button)
    test sequence scenario: Scenario_1 (InductionCookerStateFlow_HarnessButtonS1/Test Sequence)

  case "Test Case 2" [baseline]
    model InductionCoockerStateFlow, harness InductionCookerStateFlow_HarnessButtonS2 (for InductionCoockerStateFlow/on_off_button)
    test sequence scenario: Scenario_1 (InductionCookerStateFlow_HarnessButtonS2/Test Sequence)

suite "TestSuitePowerLed"

  case "Test Case 1" [baseline]
    model InductionCoockerStateFlow, harness InductionCoockerStateFlow_HarnessPowerLed (for InductionCoockerStateFlow/power_led)
    test sequence scenario: Scenario_1 (InductionCoockerStateFlow_HarnessPowerLed/Test Sequence)

suite "TestSuiteIntegration"

  case "Test Case 1" [baseline]
    model InductionCoockerStateFlow, harness InductionCookerStateFlow_HarnessIntegrationTest
    test sequence scenario: Scenario_1 (InductionCookerStateFlow_HarnessIntegrationTest/Test Sequence)